% Requirement links of Requisitos_NASH_Planta_MCP_ER_Prop_V1e_.slreqx (R2020a)

#26 verifies #10: 001-F-MCP-008-1: Por meio da IHM do simulador, o modelo do MCP deve permitir a inserção de falha pressão de boost diferente de zero.
#26 implements #10: 001-F-MCP-008-1: Por meio da IHM do simulador, o modelo do MCP deve permitir a inserção de falha pressão de boost diferente de zero.